# Grasshopper definition COC_002.gh (Grasshopper 1.0.7)
# plug-ins: Human, Kangaroo2 Components

number_slider = Slider(16, range=0..20)
plane = Plane(PlaneXY(0, 0, 0))
rectangular = Rectangular(Plane=plane, SizeX="1", SizeY="1", ExtentX=number_slider, ExtentY=number_slider)  # -> Cells, Points
list_length = ListLength(List=flatten(rectangular.Points))
number_slider_2 = Slider(61, range=41..61)
panel = Panel(list_length)
point = Point(flatten(rectangular.Points))
subtraction = Subtraction(A=panel, B=Slider(4, range=2..5))
random_reduce = RandomReduce(List=point, Reduction=subtraction, Seed=number_slider_2)
point_2 = Point(random_reduce)
deconstruct = Deconstruct(Point=point_2)  # -> XComponent, YComponent, ZComponent
sort_list = SortList(Keys=deconstruct.YComponent, ValuesValuesA=deconstruct.XComponent)  # -> Keys, ValuesValuesA
sort_list_2 = SortList(Keys=deconstruct.XComponent, ValuesValuesA=deconstruct.YComponent)  # -> Keys, ValuesValuesA
construct_point = ConstructPoint(XCoordinate=sort_list_2.Keys, YCoordinate=sort_list.ValuesValuesA, ZCoordinate=0)
construct_domain = ConstructDomain(DomainStart=0, DomainEnd=Slider(1, range=0..1))
point_3 = Point(flatten(construct_point))
interpolate = Interpolate(Vertices=point_3, Degree=3, Periodic=False, KnotStyle=1)  # -> Curve, Length, Domain
range = Range(Domain=construct_domain, Steps=10)
graph_mapper = GraphMapper(
    range,
    x0=0,
    x1=1,
    y0=0,
    y1=1,
    container_name="Bezier",
    cpx=[0, 0.585084796, 0.5718711019, 1],
    cpy=[0, 0.904869616, 0.320546031, 1])
graph_mapper_2 = GraphMapper(
    graph_mapper,
    x0=0,
    x1=1,
    y0=0,
    y1=1,
    Ox=0.4834976196,
    Oy=0.7944930792,
    Px=0.1621307433,
    Py=0.28644526,
    container_name="Parabola")
offset_curve = OffsetCurve(Curve=interpolate.Curve, Distance=graph_mapper_2, Corners=1)
unit_z = UnitZ(Factor=graph_mapper)
move = Move(Geometry=flatten(offset_curve), Motion=unit_z)  # -> Geometry, Transform
loft = Loft(Curves=move.Geometry, Options={Adjust=False, Closed=False, LoftEnds=0, LoftSimp=0, LoftType=0, Rebuild=10, Refit=0.01})
deconstruct_brep = DeconstructBrep(Brep=loft)  # -> Faces, Edges, Vertices
list_item = ListItem(List=deconstruct_brep.Edges, Index=0, Wrap=True)  # -> Item, Item1, Item2, Item3, Item4, Item5, Item6
curve = Curve(list_item.Item)
curve_2 = Curve(list_item.Item2)
curve_3 = Curve(list_item.Item1)
curve_4 = Curve(list_item.Item4)
curve_5 = Curve(list_item.Item3)
curve_6 = Curve(list_item.Item5)
join_curves = JoinCurves(Curves=[curve_4, curve_3], Preserve=False)
end_points = EndPoints(Curve=curve)  # -> Start, End
end_points_2 = EndPoints(Curve=curve_2)  # -> Start, End
join_curves_2 = JoinCurves(Curves=[curve_6, curve_5], Preserve=False)
line = Line(StartPoint=end_points.Start, EndPoint=end_points.End)
line_2 = Line(StartPoint=end_points_2.Start, EndPoint=end_points_2.End)
flip_curve = FlipCurve(Curve=join_curves_2, Guide=join_curves)  # -> Curve, Flag
loft_2 = Loft(
    Curves=[curve_2, line_2],
    Options={Adjust=False, Closed=False, LoftEnds=0, LoftSimp=0, LoftType=0, Rebuild=10, Refit=0.01})
loft_3 = Loft(
    Curves=flip_curve.Curve,
    Options={Adjust=False, Closed=False, LoftEnds=0, LoftSimp=0, LoftType=0, Rebuild=10, Refit=0.01})
loft_4 = Loft(Curves=[line, curve], Options={Adjust=False, Closed=False, LoftEnds=0, LoftSimp=0, LoftType=0, Rebuild=10, Refit=0.01})
merge = Merge(Data1=loft, Data2=loft_3, Data3=loft_4, Data4=loft_2)
brep_join = BrepJoin(Breps=flatten(merge))  # -> Breps, Closed
volume = Volume(Geometry=brep_join.Breps)  # -> Volume, Centroid
construct_point_2 = ConstructPoint(XCoordinate=number_slider_2, YCoordinate=0, ZCoordinate=0)
deconstruct_brep_2 = DeconstructBrep(Brep=brep_join.Breps)  # -> Faces, Edges, Vertices
orient = Orient(Geometry=deconstruct_brep_2.Faces, Source=volume.Centroid, Target=construct_point_2)  # -> Geometry, Transform
bake_geometry = BakeGeometry(Bake=Toggle(True), Geometry=orient.Geometry, DeleteOldBakes=False, PreserveTrees=False)
curve_7 = Curve([<curve referenced from the Rhino model> x444])  # disabled
multipipe = MultiPipe(Curves=curve_7, NodeSize=0.5, EndOffset=1, StrutSize=1, Segment=0, KinkAngle=0.6, CubeFit=0, Caps=0)  # disabled
