# Grasshopper definition COC_003_Tutorial.gh (Grasshopper 1.0.7)

number_slider = Slider(20, range=0..20)
plane = Plane(PlaneXY(0, 0, 0))
panel = Panel("Caves of Choas")
rectangular = Rectangular(Plane=plane, SizeX="1", SizeY="1", ExtentX=number_slider, ExtentY=number_slider)  # -> Cells, Points
list_length = ListLength(List=flatten(rectangular.Points))
panel_2 = Panel(list_length)
point = Point(flatten(rectangular.Points))
subtraction = Subtraction(A=panel_2, B=Slider(4, range=2..5))
random_reduce = RandomReduce(List=point, Reduction=subtraction, Seed=Slider(61, range=41..61))
point_2 = Point(random_reduce)
deconstruct = Deconstruct(Point=point_2)  # -> XComponent, YComponent, ZComponent
sort_list = SortList(Keys=deconstruct.XComponent, ValuesA=deconstruct.YComponent)  # -> Keys, ValuesA
sort_list_2 = SortList(Keys=deconstruct.YComponent, ValuesValuesA=deconstruct.XComponent)  # -> Keys, ValuesValuesA
number_slider_2 = Slider(14, range=0..100)
construct_point = ConstructPoint(XCoordinate=sort_list.Keys, YCoordinate=sort_list_2.ValuesValuesA, ZCoordinate=0)
construct_domain = ConstructDomain(DomainStart=0, DomainEnd=Slider(1, range=0..1))
point_3 = Point(construct_point)
range = Range(Domain=construct_domain, Steps=number_slider_2)
interpolate = Interpolate(Vertices=point_3, Degree=3, Periodic=False, KnotStyle=1)  # -> Curve, Length, Domain
graph_mapper = GraphMapper(
    range,
    x0=0,
    x1=15,
    y0=0,
    y1=15,
    container_name="Bezier",
    cpx=[0, 0.1121728867, 0.4483872652, 1],
    cpy=[0, 0.7411596179, 0.9932370186, 0.7789724469])
graph_mapper_2 = GraphMapper(
    graph_mapper,
    x0=0,
    x1=15,
    y0=0,
    y1=15,
    container_name="Sine",
    Equation_px=[0, 0.5718834996],
    Equation_py=[0, 0.9791308641])
offset_curve = OffsetCurve(Curve=interpolate.Curve, Distance=graph_mapper_2, Corners=1)
unit_z = UnitZ(Factor=graph_mapper)
move = Move(Geometry=flatten(offset_curve), Motion=unit_z)  # -> Geometry, Transform
loft = Loft(Curves=move.Geometry, Options={Adjust=False, Closed=False, LoftEnds=0, LoftSimp=0, LoftType=0, Rebuild=10, Refit=0.01})
deconstruct_brep = DeconstructBrep(Brep=loft)  # -> Faces, Edges, Vertices
list_item = ListItem(List=deconstruct_brep.Edges, Index=0, Wrap=True)  # -> Item, Item1, Item2, Item3, Item4
divide_curve = DivideCurve(Curve=move.Geometry, Count=number_slider_2, Kinks=False)  # -> Points, Tangents, Parameters
curve = Curve(list_item.Item1)
curve_2 = Curve(list_item.Item3)
list_length_2 = ListLength(List=flatten(divide_curve.Points))
list_item_2 = ListItem(List=deconstruct_brep.Vertices, Index=0, Wrap=True)  # -> Item, Item1, Item2, Item3
point_4 = Point(flatten(divide_curve.Points))
panel_3 = Panel(list_length_2)
line = Line(StartPoint=flatten(list_item_2.Item3), EndPoint=list_item_2.Item)
subtraction_2 = Subtraction(A=panel_3, B=Slider(14, range=0..100))
offset_curve_2 = OffsetCurve(Curve=curve, Distance=Slider(12, range=0..100), Corners=1)
loft_2 = Loft(Curves=[curve_2, line], Options={Adjust=False, Closed=False, LoftEnds=0, LoftSimp=0, LoftType=0, Rebuild=10, Refit=0.01})
random_reduce_2 = RandomReduce(List=point_4, Reduction=subtraction_2, Seed=Slider(37, range=0..100))
loft_3 = Loft(
    Curves=flatten([curve, offset_curve_2]),
    Options={Adjust=False, Closed=False, LoftEnds=0, LoftSimp=0, LoftType=0, Rebuild=10, Refit=0.01})
area = Area(Geometry=loft_2)  # -> Area, Centroid
point_5 = Point(random_reduce_2)
point_6 = Point(area.Centroid)
vector_2pt = Vector2Pt(PointA=point_6, PointB=point_5, Unitize=False)  # -> Vector, Length
deconstruct_vector = DeconstructVector(Vector=vector_2pt.Vector)  # -> XComponent, YComponent, ZComponent
vector_xyz = VectorXYZ(XComponent=deconstruct_vector.XComponent, YComponent=deconstruct_vector.YComponent, ZComponent=0)  # -> Vector, Length
range_2 = Range(Domain=Domain(0, 1), Steps=number_slider_2)
vector_display = VectorDisplay(Anchor=point_6, Vector=vector_xyz.Vector)
multiplication = Multiplication(A=range_2, B=vector_xyz.Vector)
move_2 = Move(Geometry=point_5, Motion=multiplication)  # -> Geometry, Transform
line_2 = Line(StartPoint=point_5, EndPoint=move_2.Geometry)
number_slider_3 = Slider(0.58, range=0..1)
divide_curve_2 = DivideCurve(Curve=line_2, Count=number_slider_2, Kinks=False)  # -> Points, Tangents, Parameters
pi = Pi(Factor=number_slider_3)
rotate = Rotate(Vector=divide_curve_2.Tangents, Axis=line_2, Angle=pi)
vector_display_2 = VectorDisplay(Anchor=divide_curve_2.Points, Vector=rotate)
move_3 = Move(Geometry=divide_curve_2.Points, Motion=rotate)  # -> Geometry, Transform
interpolate_2 = Interpolate(Vertices=move_3.Geometry, Degree=3, Periodic=False, KnotStyle=1)  # -> Curve, Length, Domain
pipe = Pipe(Curve=interpolate_2.Curve, Radius=number_slider_3, Caps=Slider(2, range=0..2))
