# Grasshopper definition SurvivalGuide_001.gh (Grasshopper 1.0.7)

number_slider = Slider(20, range=0..20)
plane = Plane(PlaneXY(0, 0, 0))
rectangular = Rectangular(Plane=plane, SizeX="1", SizeY="1", ExtentX=number_slider, ExtentY=number_slider)  # -> Cells, Points
list_length = ListLength(List=flatten(rectangular.Points))
panel = Panel(list_length)
point = Point(flatten(rectangular.Points))
subtraction = Subtraction(A=panel, B=Slider(4, range=2..5))
random_reduce = RandomReduce(List=point, Reduction=subtraction, Seed=Slider(61, range=41..61))
point_2 = Point(random_reduce)
deconstruct = Deconstruct(Point=point_2)  # -> XComponent, YComponent, ZComponent
sort_list = SortList(Keys=deconstruct.YComponent, ValuesValuesA=deconstruct.XComponent)  # -> Keys, ValuesValuesA
sort_list_2 = SortList(Keys=deconstruct.XComponent, ValuesValuesA=deconstruct.YComponent)  # -> Keys, ValuesValuesA
construct_domain = ConstructDomain(DomainStart=0, DomainEnd=Slider(1, range=0..1))
construct_point = ConstructPoint(XCoordinate=sort_list_2.Keys, YCoordinate=sort_list.ValuesValuesA, ZCoordinate=0)
number_slider_2 = Slider(14, range=0..16)
point_3 = Point(flatten(construct_point))
range = Range(Domain=construct_domain, Steps=number_slider_2)
interpolate = Interpolate(Vertices=point_3, Degree=3, Periodic=False, KnotStyle=1)  # -> Curve, Length, Domain
graph_mapper = GraphMapper(
    range,
    x0=0,
    x1=15,
    y0=0,
    y1=15,
    container_name="Bezier",
    cpx=[0, 0, 0.5541038513, 1],
    cpy=[0, 1, 0.37081182, 0.8850362897])
graph_mapper_2 = GraphMapper(
    graph_mapper,
    x0=0,
    x1=15,
    y0=0,
    y1=15,
    container_name="Sine",
    Equation_px=[0, 0.4698931575],
    Equation_py=[0, 0.952884376])
offset_curve = OffsetCurve(Curve=interpolate.Curve, Distance=graph_mapper_2, Corners=1)
unit_z = UnitZ(Factor=graph_mapper)
move = Move(Geometry=flatten(offset_curve), Motion=unit_z)  # -> Geometry, Transform
loft = Loft(Curves=move.Geometry, Options={Adjust=False, Closed=False, LoftEnds=0, LoftSimp=0, LoftType=0, Rebuild=10, Refit=0.01})
deconstruct_brep = DeconstructBrep(Brep=loft)  # -> Faces, Edges, Vertices
divide_curve = DivideCurve(Curve=move.Geometry, Count=number_slider_2, Kinks=False)  # -> Points, Tangents, Parameters
list_length_2 = ListLength(List=flatten(divide_curve.Points))
list_item = ListItem(List=deconstruct_brep.Edges, Index=0, Wrap=True)  # -> Item, Item1, Item2, Item3, Item4
curve = Curve(list_item.Item4)
curve_2 = Curve(list_item.Item1)
curve_3 = Curve(list_item.Item3)
panel_2 = Panel(list_length_2)
point_4 = Point(flatten(divide_curve.Points))
subtraction_2 = Subtraction(A=panel_2, B=Slider(14, range=2..15))
list_item_2 = ListItem(List=deconstruct_brep.Vertices, Index=0, Wrap=True)  # -> Item, Item1, Item2, Item3
line = Line(StartPoint=list_item_2.Item3, EndPoint=list_item_2.Item)
random_reduce_2 = RandomReduce(List=point_4, Reduction=subtraction_2, Seed=Slider(53, range=41..61))
offset_curve_2 = OffsetCurve(Curve=curve_2, Distance=Slider(12, range=0..100), Corners=1)
point_5 = Point(random_reduce_2)
loft_2 = Loft(
    Curves=flatten([line, curve_3]),
    Options={Adjust=False, Closed=False, LoftEnds=0, LoftSimp=0, LoftType=0, Rebuild=10, Refit=0.01})
loft_3 = Loft(
    Curves=flatten([curve_2, offset_curve_2]),
    Options={Adjust=False, Closed=False, LoftEnds=0, LoftSimp=0, LoftType=0, Rebuild=10, Refit=0.01})
area = Area(Geometry=loft_2)  # -> Area, Centroid
vector_2pt = Vector2Pt(PointA=area.Centroid, PointB=point_5, Unitize=False)  # -> Vector, Length
deconstruct_vector = DeconstructVector(Vector=vector_2pt.Vector)  # -> XComponent, YComponent, ZComponent
vector_xyz = VectorXYZ(XComponent=deconstruct_vector.XComponent, YComponent=deconstruct_vector.YComponent, ZComponent=0)  # -> Vector, Length
range_2 = Range(Domain=Domain(0, 1), Steps=number_slider_2)
multiplication = Multiplication(A=range_2, B=vector_xyz.Vector)
move_2 = Move(Geometry=point_5, Motion=multiplication)  # -> Geometry, Transform
line_2 = Line(StartPoint=point_5, EndPoint=move_2.Geometry)
number_slider_3 = Slider(0.44, range=0..2)
divide_curve_2 = DivideCurve(Curve=line_2, Count=number_slider_2, Kinks=False)  # -> Points, Tangents, Parameters
pi = Pi(Factor=number_slider_3)
rotate = Rotate(Vector=divide_curve_2.Tangents, Axis=line_2, Angle=pi)
vector_display = VectorDisplay(Anchor=divide_curve_2.Points, Vector=rotate)
move_3 = Move(Geometry=divide_curve_2.Points, Motion=rotate)  # -> Geometry, Transform
interpolate_2 = Interpolate(Vertices=move_3.Geometry, Degree=3, Periodic=False, KnotStyle=1)  # -> Curve, Length, Domain
panel_3 = Panel("1")
pipe = Pipe(Curve=interpolate_2.Curve, Radius=number_slider_3, Caps="2")
