# Grasshopper definition SurvivalGuide_002.gh (Grasshopper 1.0.7)

panel = Panel("Natural Underground Locales")
number_slider = Slider(21, range=0..100)
plane = Plane(PlaneXY(0, 0, 0))
number_slider_2 = Slider(20, range=0..20)  # disabled
radial = Radial(Plane=plane, Size="1", ExtentR=number_slider, ExtentP=number_slider)  # -> Cells, flatten(Points)
plane_2 = Plane(PlaneXY(0, 0, 0))  # disabled
panel_2 = Panel("1")  # disabled
list_length = ListLength(List=radial.Points)
rectangular = Rectangular(Plane=plane_2, SizeX=panel_2, SizeY=panel_2, ExtentX=number_slider_2, ExtentY=number_slider_2)  # -> Cells, Points; disabled
point = Point(radial.Points)
subtraction = Subtraction(A=list_length, B=Slider(12, range=0..100))
list_length_2 = ListLength(List=flatten(rectangular.Points))  # disabled
random_reduce = RandomReduce(List=point, Reduction=subtraction, Seed=Slider(22, range=0..100))
number_slider_3 = Slider(4, range=2..5)  # disabled
number_slider_4 = Slider(61, range=41..61)  # disabled
panel_3 = Panel(list_length_2)  # disabled
point_2 = Point(flatten(rectangular.Points))  # disabled
subtraction_2 = Subtraction(A=panel_3, B=number_slider_3)  # disabled
random_reduce_2 = RandomReduce(List=point_2, Reduction=subtraction_2, Seed=number_slider_4)  # disabled
point_3 = Point(random_reduce_2)  # disabled
deconstruct = Deconstruct(Point=point_3)  # -> XComponent, YComponent, ZComponent; disabled
number_slider_5 = Slider(1, range=0..1)  # disabled
sort_list = SortList(Keys=deconstruct.YComponent, ValuesValuesA=deconstruct.XComponent)  # -> Keys, ValuesValuesA; disabled
sort_list_2 = SortList(Keys=deconstruct.XComponent, ValuesValuesA=deconstruct.YComponent)  # -> Keys, ValuesValuesA; disabled
construct_domain = ConstructDomain(DomainStart=0, DomainEnd=number_slider_5)  # disabled
construct_point = ConstructPoint(XCoordinate=sort_list_2.Keys, YCoordinate=sort_list.ValuesValuesA, ZCoordinate=0)  # disabled
number_slider_6 = Slider(14, range=0..16)  # disabled
point_4 = Point(flatten(construct_point))  # disabled
range = Range(Domain=construct_domain, Steps=number_slider_6)  # disabled
interpolate = Interpolate(Vertices=point_4, Degree=3, Periodic=False, KnotStyle=1)  # -> Curve, Length, Domain; disabled
graph_mapper = GraphMapper(
    range,
    x0=0,
    x1=15,
    y0=0,
    y1=15,
    container_name="Bezier",
    cpx=[0, 0, 0.5541038513, 1],
    cpy=[0, 1, 0.37081182, 0.8850362897])  # disabled
graph_mapper_2 = GraphMapper(
    graph_mapper,
    x0=0,
    x1=15,
    y0=0,
    y1=15,
    container_name="Sine",
    Equation_px=[0, 0.4698931575],
    Equation_py=[0, 0.952884376])  # disabled
offset_curve = OffsetCurve(Curve=interpolate.Curve, Distance=graph_mapper_2, Corners=1)  # disabled
unit_z = UnitZ(Factor=graph_mapper)  # disabled
move = Move(Geometry=flatten(offset_curve), Motion=unit_z)  # -> Geometry, Transform; disabled
loft = Loft(Curves=move.Geometry, Options={Adjust=False, Closed=False, LoftEnds=0, LoftSimp=0, LoftType=0, Rebuild=10, Refit=0.01})  # disabled
deconstruct_brep = DeconstructBrep(Brep=loft)  # -> Faces, Edges, Vertices; disabled
divide_curve = DivideCurve(Curve=move.Geometry, Count=number_slider_6, Kinks=False)  # -> Points, Tangents, Parameters; disabled
list_length_3 = ListLength(List=flatten(divide_curve.Points))  # disabled
list_item = ListItem(List=deconstruct_brep.Edges, Index=0, Wrap=True)  # -> Item, Item1, Item2, Item3, Item4; disabled
number_slider_7 = Slider(14, range=2..15)  # disabled
number_slider_8 = Slider(53, range=41..61)  # disabled
curve = Curve(list_item.Item1)  # disabled
curve_2 = Curve(list_item.Item4)  # disabled
curve_3 = Curve(list_item.Item3)  # disabled
panel_4 = Panel(list_length_3)  # disabled
point_5 = Point(flatten(divide_curve.Points))  # disabled
number_slider_9 = Slider(12, range=0..100)  # disabled
subtraction_3 = Subtraction(A=panel_4, B=number_slider_7)  # disabled
list_item_2 = ListItem(List=deconstruct_brep.Vertices, Index=0, Wrap=True)  # -> Item, Item1, Item2, Item3; disabled
line = Line(StartPoint=list_item_2.Item3, EndPoint=list_item_2.Item)  # disabled
random_reduce_3 = RandomReduce(List=point_5, Reduction=subtraction_3, Seed=number_slider_8)  # disabled
offset_curve_2 = OffsetCurve(Curve=curve, Distance=number_slider_9, Corners=1)  # disabled
point_6 = Point(random_reduce_3)  # disabled
loft_2 = Loft(
    Curves=flatten([line, curve_3]),
    Options={Adjust=False, Closed=False, LoftEnds=0, LoftSimp=0, LoftType=0, Rebuild=10, Refit=0.01})  # disabled
loft_3 = Loft(
    Curves=flatten([curve, offset_curve_2]),
    Options={Adjust=False, Closed=False, LoftEnds=0, LoftSimp=0, LoftType=0, Rebuild=10, Refit=0.01})  # disabled
area = Area(Geometry=loft_2)  # -> Area, Centroid; disabled
vector_2pt = Vector2Pt(PointA=area.Centroid, PointB=point_6, Unitize=False)  # -> Vector, Length; disabled
deconstruct_vector = DeconstructVector(Vector=vector_2pt.Vector)  # -> XComponent, YComponent, ZComponent; disabled
vector_xyz = VectorXYZ(XComponent=deconstruct_vector.XComponent, YComponent=deconstruct_vector.YComponent, ZComponent=0)  # -> Vector, Length; disabled
range_2 = Range(Domain=Domain(0, 1), Steps=number_slider_6)  # disabled
multiplication = Multiplication(A=range_2, B=vector_xyz.Vector)  # disabled
move_2 = Move(Geometry=point_6, Motion=multiplication)  # -> Geometry, Transform; disabled
line_2 = Line(StartPoint=point_6, EndPoint=move_2.Geometry)  # disabled
number_slider_10 = Slider(0.44, range=0..2)  # disabled
divide_curve_2 = DivideCurve(Curve=line_2, Count=number_slider_6, Kinks=False)  # -> Points, Tangents, Parameters; disabled
pi = Pi(Factor=number_slider_10)  # disabled
rotate = Rotate(Vector=divide_curve_2.Tangents, Axis=line_2, Angle=pi)  # disabled
vector_display = VectorDisplay(Anchor=divide_curve_2.Points, Vector=rotate)  # disabled
move_3 = Move(Geometry=divide_curve_2.Points, Motion=rotate)  # -> Geometry, Transform; disabled
interpolate_2 = Interpolate(Vertices=move_3.Geometry, Degree=3, Periodic=False, KnotStyle=1)  # -> Curve, Length, Domain; disabled
panel_5 = Panel("1")  # disabled
panel_6 = Panel("2")  # disabled
pipe = Pipe(Curve=interpolate_2.Curve, Radius=number_slider_10, Caps=panel_6)  # disabled
