# Grasshopper definition SurvivalGuide_004.gh (Grasshopper 1.0.7)

panel = Panel("Cave Formations")
xz_plane = XZPlane(Origin=Point(0, 0, 0))
rectangular = Rectangular(Plane=xz_plane, SizeX="1", SizeY="1", ExtentX=Slider(100, range=0..100), ExtentY=Slider(25, range=0..100))  # -> Cells, flatten(Points)
list_length = ListLength(List=rectangular.Points)
point = Point(rectangular.Points)
subtraction = Subtraction(A=list_length, B=Slider(14, range=0..30))
construct_domain = ConstructDomain(DomainStart=Slider(0.529, range=0..10), DomainEnd=Slider(2.513, range=0..10))
construct_domain_2 = ConstructDomain(DomainStart=Slider(0.624, range=0..10), DomainEnd=Slider(5.012, range=0..10))
random_reduce = RandomReduce(List=point, Reduction=subtraction, Seed=Slider(18, range=0..100))
xz_plane_2 = XZPlane(Origin=random_reduce)
range = Range(Domain=construct_domain, Steps=10)
range_2 = Range(Domain=construct_domain_2, Steps=10)
ellipse = Ellipse(Plane=xz_plane_2, Radius1=range_2, Radius2=range)  # -> Ellipse, Focus1, Focus2
point_on_curve = PointOnCurve(ellipse.Ellipse, parameter=0.731)
shift_list = ShiftList(List=point_on_curve, Shift=Slider(2, range=0..10), Wrap=Toggle(True))
line = Line(StartPoint=point_on_curve, EndPoint=shift_list)
construct_domain_3 = ConstructDomain(DomainStart=Slider(1.51, range=0..10), DomainEnd=Slider(1.56, range=0..10))
list_length_2 = ListLength(List=flatten(line))
range_3 = Range(Domain=construct_domain_3, Steps=expr("x-1", list_length_2))
panel_2 = Panel(range_3)
offset_curve = OffsetCurve(Curve=line, Distance=range_3, Plane=xz_plane_2, Corners=1)
curve = Curve(graft(line))
loft = Loft(
    Curves=[curve, offset_curve],
    Options={Adjust=False, Closed=False, LoftEnds=0, LoftSimp=0, LoftType=0, Rebuild=10, Refit=0.01})
deconstruct_brep = DeconstructBrep(Brep=loft)  # -> Faces, Edges, Vertices
area = Area(Geometry=ellipse.Ellipse)  # -> Area, Centroid
area_2 = Area(Geometry=deconstruct_brep.Faces)  # -> Area, Centroid
curve_2 = Curve(deconstruct_brep.Edges)
scale = Scale(Geometry=ellipse.Ellipse, Center=area.Centroid, Factor=Slider(1.39, range=0..2))  # -> Geometry, Transform
scale_2 = Scale(Geometry=curve_2, Center=area_2.Centroid, Factor=Slider(1, range=0..1))  # -> Geometry, Transform
xz_plane_3 = XZPlane(Origin=area_2.Centroid)
join_curves = JoinCurves(Curves=flatten(scale_2.Geometry), Preserve=False)
region_union = RegionUnion(Curves=join_curves, Plane=xz_plane_3)
region_union_2 = RegionUnion(Curves=scale.Geometry, Plane=xz_plane_2)
region_union_3 = RegionUnion(Curves=flatten([region_union, region_union_2]), Plane=xz_plane_3)
