# Grasshopper definition SurvivalGuide_006.gh (Grasshopper 1.0.7)

negative = Negative(Value=Slider(10, range=0..20))
construct_point = ConstructPoint(XCoordinate=0, YCoordinate=0, ZCoordinate=negative)
panel = Panel("Cave Formations")
xz_plane = XZPlane(Origin=construct_point)
rectangular = Rectangular(Plane=xz_plane, SizeX="1", SizeY="1", ExtentX=Slider(210, range=0..1000), ExtentY=Slider(50, range=0..50))  # -> Cells, flatten(Points)
list_length = ListLength(List=rectangular.Points)
point = Point(rectangular.Points)
subtraction = Subtraction(A=list_length, B=Slider(14, range=0..30))
construct_domain = ConstructDomain(DomainStart=Slider(0.529, range=0..10), DomainEnd=Slider(2.513, range=0..10))
construct_domain_2 = ConstructDomain(DomainStart=Slider(0.624, range=0..10), DomainEnd=Slider(5.012, range=0..10))
random_reduce = RandomReduce(List=point, Reduction=subtraction, Seed=Slider(10, range=0..50))
xz_plane_2 = XZPlane(Origin=random_reduce)
range = Range(Domain=construct_domain, Steps=10)
range_2 = Range(Domain=construct_domain_2, Steps=10)
ellipse = Ellipse(Plane=xz_plane_2, Radius1=range_2, Radius2=range)  # -> Ellipse, Focus1, Focus2
point_on_curve = PointOnCurve(ellipse.Ellipse, parameter=0.731)
shift_list = ShiftList(List=point_on_curve, Shift=Slider(2, range=0..10), Wrap=Toggle(True))
line = Line(StartPoint=point_on_curve, EndPoint=shift_list)
construct_domain_3 = ConstructDomain(DomainStart=Slider(1.51, range=0..10), DomainEnd=Slider(1.56, range=0..10))
list_length_2 = ListLength(List=flatten(line))
range_3 = Range(Domain=construct_domain_3, Steps=expr("x-1", list_length_2))
panel_2 = Panel(range_3)
offset_curve = OffsetCurve(Curve=line, Distance=range_3, Plane=xz_plane_2, Corners=1)
curve = Curve(graft(line))
loft = Loft(
    Curves=[curve, offset_curve],
    Options={Adjust=False, Closed=False, LoftEnds=0, LoftSimp=0, LoftType=0, Rebuild=10, Refit=0.01})
deconstruct_brep = DeconstructBrep(Brep=loft)  # -> Faces, Edges, Vertices
area = Area(Geometry=ellipse.Ellipse)  # -> Area, Centroid
negative_2 = Negative(Value="150")
area_2 = Area(Geometry=deconstruct_brep.Faces)  # -> Area, Centroid
curve_2 = Curve(deconstruct_brep.Edges)
construct_point_2 = ConstructPoint(XCoordinate=["150", negative_2], YCoordinate=0, ZCoordinate=0)
scale = Scale(Geometry=ellipse.Ellipse, Center=area.Centroid, Factor=Slider(1.39, range=0..2))  # -> Geometry, Transform
scale_2 = Scale(Geometry=curve_2, Center=area_2.Centroid, Factor=Slider(1, range=0..1))  # -> Geometry, Transform
xz_plane_3 = XZPlane(Origin=area_2.Centroid)
explode_tree = ExplodeTree(Data=graft(construct_point_2))  # -> Branch0, Branch1
join_curves = JoinCurves(Curves=flatten(scale_2.Geometry), Preserve=False)
line_2 = Line(StartPoint=explode_tree.Branch0, EndPoint=explode_tree.Branch1)
divide_curve = DivideCurve(Curve=line_2, Count=Slider(100, range=0..100), Kinks=False)  # -> Points, Tangents, Parameters
unit_z = UnitZ(Factor=1)
region_union = RegionUnion(Curves=join_curves, Plane=xz_plane_3)
region_union_2 = RegionUnion(Curves=scale.Geometry, Plane=xz_plane_2)
negative_3 = Negative(Value=unit_z)
region_union_3 = RegionUnion(Curves=flatten([region_union, region_union_2]), Plane=xz_plane_3)
project_point = ProjectPoint(Point=divide_curve.Points, Direction=graft([unit_z, negative_3]), Geometry=flatten(region_union_3))  # -> Point, Index
interpolate = Interpolate(Vertices=project_point.Point, Degree=3, Periodic=False, KnotStyle=1)  # -> Curve, Length, Domain
explode_tree_2 = ExplodeTree(Data=graft(interpolate.Curve))  # -> _0000, _0010
end_points = EndPoints(Curve=explode_tree_2._0000)  # -> Start, End
end_points_2 = EndPoints(Curve=explode_tree_2._0010)  # -> Start, End
line_3 = Line(StartPoint=end_points.Start, EndPoint=end_points.End)
line_4 = Line(StartPoint=end_points_2.Start, EndPoint=end_points_2.End)
revolution = Revolution(Curve=explode_tree_2._0010, Axis=line_3, Domain=Domain(0, 6.283185307))
revolution_2 = Revolution(Curve=explode_tree_2._0000, Axis=line_4, Domain=Domain(0, 6.283185307))
